# Grasshopper definition Folding_facade.gh (Grasshopper 1.0.8)
# plug-ins: Pufferfish

# ---- group: Swap Pleat Side
toggle = BooleanToggle(False)

# ---- group: Surfaces to fold
# Inputs
srf = Surface(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)

# ---- group: Swap Pleat Direction
toggle_2 = BooleanToggle(False)

# ---- group: Density
width_of_one_fold = Slider(0.5, range=0..10)

# ---- group: Articulation
peak_height = Slider(0.3, range=0..10)

# ----
pleat_direction = GetBoolean(toggle_2, AtLeast=1, AtMost=1, FalseValue="False", TreeAccess=False, TrueValue="True")

# ---- group: resolution - the smaller the finer
number_slider = Slider(2, range=0..10)

# ----
graft = GraftTree(Tree=srf, IncludeEmptyLists=True, IncludeNullItems=True)
density = GetNumber(width_of_one_fold, AtLeast=1, AtMost=1, Maximum=1.797693135e+308, Minimum=-1.797693135e+308, TreeAccess=False)
articulation = GetNumber(peak_height, AtLeast=1, AtMost=1, Maximum=1.797693135e+308, Minimum=-1.797693135e+308, TreeAccess=False)
swapsrfdir = SwapSurfaceDirections(Surface=graft, ReverseU=False, ReverseV=pleat_direction, SwapUV=pleat_direction)
edges = BrepEdges(Brep=swapsrfdir)  # -> Naked, Interior, NonManifold
item = ListItem(List=edges.Naked, Index=0, Wrap=True)  # -> Item, Item1
len = Length(Curve=item.Item1)
len_2 = Length(Curve=item.Item)
division = Division(A=len_2, B=density)
division_2 = Division(A=len, B=number_slider)
division_3 = Division(A=len_2, B=number_slider)
expression = Expression(x=division, Expression="x/2")
rebsrf = RebuildSurface(Surface=swapsrfdir, CountU=division_3, CountV=division_2)
neg = Negative(Value=articulation)
int = Integer(expression)
expression_2 = Expression(x=int, Expression="x*2")
merge = Merge(Data1=articulation, Data2=neg)
range = Range(Domain=Domain(0, 1), Steps=expression_2)
pt = ConstructPoint(XCoordinate=range, YCoordinate=0, ZCoordinate=0)
item_2 = ListItem(List=merge, Index=toggle, Wrap=True)
offset_l = OffsetSurfaceLoose(Surface=rebsrf, Distance=item_2, Retrim=True)
iso = IsoCurve(Surface=reparameterize(rebsrf), UVPoint=pt)  # -> UIsocurve, VIsocurve
iso_2 = IsoCurve(Surface=reparameterize(offset_l), UVPoint=pt)  # -> UIsocurve, VIsocurve
pshift = ShiftPaths(Data=iso.VIsocurve, Offset=-1)
pshift_2 = ShiftPaths(Data=iso_2.VIsocurve, Offset=-1)
crv = Curve(pshift)
crv_2 = Curve(pshift_2)
dispatch = Dispatch(List=crv, DispatchPattern=[True, False])  # -> ListA, ListB
dispatch_2 = Dispatch(List=crv_2, DispatchPattern=[True, False])  # -> ListA, ListB
weave = Weave(Pattern=[0, 1], Stream0=dispatch.ListA, Stream1=dispatch_2.ListB, NullGaps=False)
cull_i = CullIndex(List=reverse(weave), Indices=0, Wrap=True)  # -> reverse(List)
cull_i_2 = CullIndex(List=weave, Indices=0, Wrap=True)
merge_2 = Merge(Data1=graft(cull_i), Data2=graft(cull_i_2))

# ---- group: Main frame
# Parameters for mullion
depth = Slider(0.03, range=0..0.1)
width = Slider(0.05, range=0..1)

# ----
loft = Loft(Curves=merge_2, Options={Adjust=False, Closed=False, LoftEnds=0, LoftSimp=0, LoftType=3, Rebuild=10, Refit=0.01})
debrep = DeconstructBrep(Brep=loft)  # -> Faces, Edges, Vertices
pshift_3 = ShiftPaths(Data=loft, Offset=-1)
join = BrepJoin(Breps=pshift_3)  # -> Breps, Closed
num = Number(width)
shift = ShiftList(List=debrep.Edges, Shift=1, Wrap=True)
pshift_4 = ShiftPaths(Data=shift, Offset=-1)
crv_3 = Curve(graft(debrep.Edges))
crv_4 = Curve(graft(pshift_4))
flip = FlipCurve(Curve=crv_3)  # -> Curve, Flag
end = EndPoints(Curve=flip.Curve)  # -> Start, End
eval = EvaluateLength(Curve=crv_4, Length=num, Normalized=False)  # -> Point, Tangent, Parameter
eval_2 = EvaluateLength(Curve=flip.Curve, Length=num, Normalized=False)  # -> Point, Tangent, Parameter
pt_2 = Point(end.Start)
vec2pt = Vector2Pt(PointA=pt_2, PointB=eval_2.Point, Unitize=False)  # -> Vector, Length
vec2pt_2 = Vector2Pt(PointA=pt_2, PointB=eval.Point, Unitize=False)  # -> Vector, Length
line = LineSDL(Start=eval.Point, Direction=vec2pt.Vector, Length=1)
line_2 = LineSDL(Start=eval_2.Point, Direction=vec2pt_2.Vector, Length=1)
llx = LineLine(Line1=line, Line2=line_2)  # -> ParamA, ParamB, PointA, PointB
merge_3 = Merge(Data1=pt_2, Data2=llx.PointA)
vec2pt_3 = Vector2Pt(PointA=pt_2, PointB=llx.PointA, Unitize=False)  # -> Vector, Length
xprod = CrossProduct(VectorA=vec2pt_3.Vector, VectorB=vec2pt.Vector, Unitize=False)  # -> Vector, Length
amp = Amplitude(Vector=xprod.Vector, Amplitude=expr("-x/2", depth))
move = Move(Geometry=merge_3, Motion=expr("-x", amp))  # -> Geometry, Transform
move_2 = Move(Geometry=merge_3, Motion=amp)  # -> Geometry, Transform
rev = ReverseList(List=move.Geometry)
merge_4 = Merge(Data1=move_2.Geometry, Data2=rev)
pline = PolyLine(Vertices=merge_4, Closed=True)
pshift_5 = ShiftPaths(Data=pline, Offset=-1)
shift_2 = ShiftList(List=pshift_5, Shift=1, Wrap=True)
pshift_6 = ShiftPaths(Data=shift_2, Offset=-1)
graft_2 = GraftTree(Tree=pshift_5, IncludeEmptyLists=True, IncludeNullItems=True)
graft_3 = GraftTree(Tree=pshift_6, IncludeEmptyLists=True, IncludeNullItems=True)
merge_5 = Merge(Data1=graft_2, Data2=graft_3)
swp1 = Sweep1(Rail=crv_4, Sections=merge_5, Miter=1)
pshift_7 = ShiftPaths(Data=swp1, Offset=-2)

# ---- group: Main frame
join_2 = BrepJoin(Breps=pshift_7)  # -> Breps, Closed

# ---- group: Glass
# Bake
brep = Brep(join.Breps)

# ----
mesh = Mesh([brep, join_2.Breps])
context_bake = ContextBake(Content=mesh)
